# Grasshopper definition Fanuc_WSG50_example.ghx (Grasshopper 1.0.8)
# plug-ins: Robots

list = RobotsLibrary(
    {"Fanuc-CRX-3iA", "Fanuc-CRX-5iA", "Fanuc-CRX-10iA", "Fanuc-CRX-10iA/L", "Fanuc-CRX-10iA/L Paint", "Fanuc-CRX-20iA/L", "Fanuc-CRX-30iA"}, selected="Fanuc-CRX-10iA/L",
    Type=0)
list_2 = RobotsLibrary({"WSG50"}, selected="WSG50", Type=1)
loadtool = LoadTool(Name=list_2)
loadrobotsystem = LoadRobotSystem(Name=list, Base=PlaneXY(0, 0, 0))

# ----
# Setup - Home
panel = Panel("0")
repeat = RepeatData(Data=panel, Length="6")
degreestoradians = DegreesToRadians(Degrees=repeat, RobotSystem=loadrobotsystem, MechanicalGroup=0)
createtarget = CreateTarget(Joints=degreestoradians, Tool=loadtool, IsCartesian=False)

# ----
# Pick and place
number_slider = Slider(-228.8, range=-1000..1000)
xy = XYPlane(Origin=Point(0, 0, 0))
list_3 = FlagFields({"Shoulder": 1, "Elbow": 2, "Wrist": 4}, selected=[])
pt = ConstructPoint(XCoordinate=Slider(517.9, range=-1000..1000), YCoordinate=Slider(-300, range=-1000..1000), ZCoordinate=number_slider)
pt_2 = ConstructPoint(XCoordinate=Slider(-1000, range=-1000..1000), YCoordinate=Slider(-169.2, range=-1000..1000), ZCoordinate=number_slider)
createtarget_2 = CreateTarget(Plane=xy, Configuration=list_3, Tool=loadtool, IsCartesian=True)
Z = UnitZ(Factor="-1")
pl = PlaneNormal(Origin=pt, ZAxis=Z)
pl_2 = PlaneNormal(Origin=pt_2, ZAxis=Z)

# ----
# Place
panel_2 = Panel("28")
repeat_2 = RepeatData(Data=panel_2, Length="9")
merge = Merge(Data1="0", Data2=repeat_2)  # -> flatten(Result)
repeat_3 = RepeatData(Data=pl, Length="10")
ma = MassAddition(Input=merge)  # -> Result, PartialResults
Z_2 = UnitZ(Factor=ma.PartialResults)
deplane = DeconstructPlane(Plane=repeat_3)  # -> Origin, XAxis, YAxis, ZAxis
addition = Addition(A=deplane.Origin, B=Z_2)
repeat_4 = RepeatData(Data="90", Length="10")
pl_3 = ConstructPlane(Origin=addition, XAxis=deplane.XAxis, YAxis=deplane.YAxis)
ma_2 = MassAddition(Input=repeat_4)  # -> Result, PartialResults
rad = Radians(Degrees=ma_2.PartialResults)
rotate = Rotate(Geometry=pl_3, Angle=rad, Plane=pl_3)  # -> Geometry, Transform

# ----
# Parts
panel_3 = Panel("14")
Z_3 = UnitZ(Factor=panel_3)
Z_4 = UnitZ(Factor=1)
subtraction = Subtraction(A=pt_2, B=Z_3)
pl_4 = PlaneNormal(Origin=subtraction, ZAxis=Z_4)
rectangle = Rectangle(Plane=pl_4, XSize="-200 to 200", YSize="-14 to 14", Radius=0)  # -> Rectangle, Length
boxrec = BoxRectangle(Rectangle=rectangle.Rectangle, Height="28")
mesh = Mesh(boxrec)

# ----
# Spawn (pick)
panel_4 = Panel("10")
repeat_5 = RepeatData(Data=pl_2, Length=panel_4)

pickandplace = PickAndPlace(
    Pick=repeat_5,
    Place=rotate.Geometry,
    Target=createtarget_2,
    Grip="41",
    Approach=100,
    Retreat=100,
    Part=mesh,
    Wait=Slider(2.49, range=0..5))  # -> flatten(Targets)

merge_2 = Merge(Data1=createtarget, Data2=pickandplace, Data3=createtarget)  # -> flatten(Result)
createprogram = CreateProgram(Name="DefaultProgram", RobotSystem=loadrobotsystem, Targets=merge_2, StepSize=1)  # -> Program, Code, Duration, Warnings, Errors
programsimulation = ProgramSimulation(Program=createprogram.Program, Time=Slider(0, range=0..1), Normalized=True)  # -> SystemMeshes, JointRotations, Plane, Index, Time, Program, Errors, Parts
mesh_2 = Mesh(programsimulation.SystemMeshes)
mesh_3 = Mesh(programsimulation.Parts)
preview = CustomPreview(Geometry=mesh_3, Material=ColourSwatch(SwatchColor=RGB(255, 128, 82)))
