# Grasshopper definition Fanuc_WSG50_example_multipick.ghx (Grasshopper 1.0.8)
# plug-ins: Robots

# ----
# Base
panel = Panel("468")
addition = Addition(A="245", B=panel)
pt = ConstructPoint(XCoordinate=0, YCoordinate=0, ZCoordinate=addition)
pl = ConstructPlane(Origin=pt, XAxis=Vector(1, 0, 0), YAxis=Vector(0, 1, 0))

cyl = Cylinder(Base=PlaneXY(0, 0, 0), Radius="130", Length=panel)
panel_2 = Panel("10")
capex = CapHolesEx(Brep=cyl)  # -> Brep, Caps, Solid
mesh = Mesh(capex.Brep)
preview = CustomPreview(Geometry=mesh, Material=ColourSwatch(SwatchColor=RGB(130, 130, 130)))
list = RobotsLibrary(
    {"UR3e", "UR5e", "UR10e", "UR16e", "UR3", "UR5", "UR10", "UR20", "UR30", "Fanuc-CRX-3iA", "Fanuc-CRX-5iA", "Fanuc-CRX-10iA", "Fanuc-CRX-10iA/L", "Fanuc-CRX-10iA/L Paint", "Fanuc-CRX-20iA/L", "Fanuc-CRX-30iA"}, selected="Fanuc-CRX-10iA/L",
    Type=0)
list_2 = RobotsLibrary({"WSG50 (missing)": "WSG50"}, selected="WSG50 (missing)", Type=1)
panel_3 = Panel("""-1
-1
-1
-1
-1
-1""")
loadtool = LoadTool(Name=list_2)
loadrobotsystem = LoadRobotSystem(Name=list, Base=pl, JointLimits=panel_3)

# ----
# Robot and tool setup
# Reachability analysis
# Green = Good
# Orange = Borderline
# Red = J5 Singularity region (bad)
# (This can help in figuring out why there's pick/place issues)
x_y_limits_mm = Slider(1236, range=100..2000)
neg = Negative(Value=x_y_limits_mm)
dom = ConstructDomain(DomainStart=neg, DomainEnd=x_y_limits_mm)
range = Range(Domain=dom, Steps=Slider(20, range=10..100))
pt_2 = ConstructPoint(XCoordinate=graft(range), YCoordinate=range, ZCoordinate=Slider(0, range=0..1000))  # -> flatten(Point)
item = ListItem(List=range, Index="1", Wrap=True)
item_2 = ListItem(List=range, Index=0, Wrap=True)
subtraction = Subtraction(A=item, B=item_2)
# Pick and place task
reachability = Reachability(
    RobotSystem=loadrobotsystem,
    Points=pt_2,
    Orientation=Plane(origin=(0, 0, 0), x=(1, 0, 0), y=(0, -1, 0)),
    Rotations=8,
    Tool=loadtool,
    CellSize=subtraction)  # -> Map, Score, BestRotation, LegendColours, LegendTags

# ----
# Setup - Home
panel_4 = Panel("0")
repeat = RepeatData(Data=panel_4, Length="6")
degreestoradians = DegreesToRadians(Degrees=repeat, RobotSystem=loadrobotsystem, MechanicalGroup=0)
createtarget = CreateTarget(Joints=degreestoradians, Tool=loadtool, IsCartesian=False)

# ----
# Activate Collision test (obstacle and avoidance)
# Also avoids smashing struts into each other,
# and collisions with robot pedestal
panel_5 = Panel("-1200 to -400")
# Collision checks and path planning
rectangle = Rectangle(Plane=PlaneXY(0, 0, 0), XSize="-100 to 100", YSize=panel_5, Radius=0)  # -> Rectangle, Length
boxrec = BoxRectangle(Rectangle=rectangle.Rectangle, Height=Slider(1000, range=0..2000))
collision_on_off = BooleanToggle(True)
entwine = Entwine(Branch01=boxrec, FlattenInputs=True)
gate = StreamGate(Stream=flatten(entwine), Gate=collision_on_off)  # -> Target0, Target1
geo = Geometry(gate.Target1)

geo_2 = Geometry([mesh, geo])

# ----
# Pick and place
number_slider = Slider(16, range=-1000..1000)
xy = XYPlane(Origin=Point(0, 0, 0))
list_3 = FlagFields({"Shoulder": 1, "Elbow": 2, "Wrist": 4}, selected="Shoulder")
pt_3 = ConstructPoint(XCoordinate=Slider(960.6, range=-1000..1000), YCoordinate=Slider(-83.2, range=-1000..1000), ZCoordinate=number_slider)
pt_4 = ConstructPoint(XCoordinate=Slider(-708.9, range=-1000..1000), YCoordinate=Slider(-904.1, range=-1000..1000), ZCoordinate=number_slider)
createtarget_2 = CreateTarget(Plane=xy, Configuration=list_3, Tool=loadtool, IsCartesian=True)
Z = UnitZ(Factor="-1")
pl_2 = PlaneNormal(Origin=pt_3, ZAxis=Z)

# ----
# Spawn (pick)
number_slider_2 = Slider(80, range=0..100)
vec = VectorXYZ(XComponent=0, YComponent=number_slider_2, ZComponent=0)  # -> Vector, Length
repeat_2 = RepeatData(Data=vec.Vector, Length="10")
ma = MassAddition(Input=repeat_2)  # -> Result, PartialResults
addition_2 = Addition(A=pt_4, B=ma.PartialResults)
pl_3 = PlaneNormal(Origin=addition_2, ZAxis=Z)

# ----
# Parts
panel_6 = Panel("15")
Z_2 = UnitZ(Factor=panel_6)
Z_3 = UnitZ(Factor=1)
subtraction_2 = Subtraction(A=addition_2, B=Z_2)
pl_4 = PlaneNormal(Origin=subtraction_2, ZAxis=Z_3)
rectangle_2 = Rectangle(Plane=pl_4, XSize="-200 to 200", YSize="-14 to 14", Radius=0)  # -> Rectangle, Length
boxrec_2 = BoxRectangle(Rectangle=rectangle_2.Rectangle, Height="28")
mesh_2 = Mesh(boxrec_2)

# ----
# Place
panel_7 = Panel("28")
repeat_3 = RepeatData(Data=panel_7, Length="9")
merge = Merge(Data1="0", Data2=repeat_3)  # -> flatten(Result)
repeat_4 = RepeatData(Data=pl_2, Length="10")
ma_2 = MassAddition(Input=merge)  # -> Result, PartialResults
Z_4 = UnitZ(Factor=ma_2.PartialResults)
deplane = DeconstructPlane(Plane=repeat_4)  # -> Origin, XAxis, YAxis, ZAxis
addition_3 = Addition(A=deplane.Origin, B=Z_4)
repeat_5 = RepeatData(Data="90", Length="10")
pl_5 = ConstructPlane(Origin=addition_3, XAxis=deplane.XAxis, YAxis=deplane.YAxis)
ma_3 = MassAddition(Input=repeat_5)  # -> Result, PartialResults
rad = Radians(Degrees=ma_3.PartialResults)
rotate = Rotate(Geometry=pl_5, Angle=rad, Plane=pl_5)  # -> Geometry, Transform

panel_8 = Panel(pl_3)
panel_9 = Panel(rotate.Geometry)

pickandplace = PickAndPlace(
    Pick=pl_3,
    Place=rotate.Geometry,
    Target=createtarget_2,
    Grip="41",
    Approach=100,
    Retreat=100,
    Part=mesh_2,
    Wait=Slider(2.49, range=0..5),
    Open="60",
    Symmetric=False)  # -> flatten(Targets)

entwine_2 = Entwine(Branch00=createtarget, Branch01=pickandplace, Branch02=createtarget, FlattenInputs=True)  # -> flatten(Result)
createprogram = CreateProgram(
    Name="DefaultProgram",
    RobotSystem=loadrobotsystem,
    Targets=entwine_2,
    StepSize="10",
    Collisions=collision_on_off,
    Environment=geo_2)  # -> Program, Code, Duration, Warnings, Errors
warnings = Panel(createprogram.Warnings)
errors = Panel(createprogram.Errors)
cellcollisions = CellCollisions(
    Program=createprogram.Program,
    Environment=[geo, mesh],
    PartObstacles=True,
    Clearance=2,
    LinearStepSize=10,
    AngularStepSize=0.1745329252)  # -> CollisionFound, TargetIndices, Collisions, CollidedMeshes
programsimulation = ProgramSimulation(Program=createprogram.Program, Time=Slider(1, range=0..1), Normalized=True)  # -> SystemMeshes, JointRotations, Plane, Index, Time, Program, Errors, Parts
simpletrail = SimpleTrail(Program=programsimulation.Program, Length="3000", MechanicalGroup=0)
deg = Degrees(Radians=programsimulation.JointRotations)
mesh_3 = Mesh(programsimulation.SystemMeshes)
mesh_4 = Mesh(programsimulation.Parts)
preview_2 = CustomPreview(Geometry=mesh_4, Material=ColourSwatch(SwatchColor=RGB(255, 128, 82)))
